# Grasshopper definition ForVicenteNew.gh (Grasshopper 1.0.5)

brep = Brep(<brep referenced from the Rhino model>)
mesh = Mesh(<mesh referenced from the Rhino model>)
brep_reference_shape = Brep(<brep referenced from the Rhino model>)
mesh_fabrication_graph = Mesh(<mesh referenced from the Rhino model>)
after_the_last_review = CSharpScript(r=brep_reference_shape, f=mesh_fabrication_graph)  # -> out, ACompexity, BCurvatureComplexity, CVerticesDeviation, DSumVerticesDeviation, EEdgesDeviation, FFacesDeviation, GDeviationComplexity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; inputs r: Brep, f: Mesh
# ---------- after_the_last_review: C# ----------
    // Represantation Accuracy

    // Reference Shape Complexity
    ACompexity = Complexity(r);

    List<double> ComplexityCurvature = cComplexity(r, f);
    BCurvatureComplexity = ComplexityCurvature;

    // Deviation - Vertices
    List<double> deviationV = testVertex(r, f);

    double sumErrorV = 0;
    foreach (var d in deviationV)
      sumErrorV += d;

    CVerticesDeviation = deviationV;
    DSumVerticesDeviation = sumErrorV;

    // Deviation - Edges
    List<double> deviationE = testEdge(r, f);

    EEdgesDeviation = deviationE;

    // Deviation - Faces
    List<double> deviationF = testFace(r, f);

    FFacesDeviation = deviationF;

    // Deviation - Faces / Complexity
    List<double> curvatureComplexity = cComplexity(r, f);

    List<double> deviationC = new List<double>();
    /* for (int i = 0; i <= deviationF.Count; i++)
    {
    deviationC.Add(deviationF[i] / curvatureComplexity[i]);
    } */
    GDeviationComplexity = deviationC;

    // Discretization Efficiency

    // HVerticesCongruency
    var edgeGroups = GroupEdgeByLength(f, 0.01);
    EdgeGroupKeys = edgeGroups.Select(g => g.Key);

    var edgeTree = new DataTree<int>();
    int i = 0;
    foreach(var edgeGroup in edgeGroups)
    {
      edgeTree.AddRange(edgeGroup.Value, new GH_Path(i++));
    }

    EdgeGroupValues = edgeTree;
    // GFacesCongruency
    // RatioCongruency

    //Congruent groups

    var congruentGroups = GroupFaces(f, 0.01);

    var congruentTree = new DataTree<int>();
    int j = 0;
    foreach(var congruentGroup in congruentGroups)
    {
      congruentTree.AddRange(congruentGroup, new GH_Path(j++));
    }

    CongruentGroups = congruentTree;
# ---------- after_the_last_review: C# additional code ----------
  // Represantation Accuracy

  // Reference Shape Complexity: R area / Bb volume
  double Complexity (Brep reference)
  {
    double area = reference.GetArea();
    BoundingBox bb = reference.GetBoundingBox(true);
    double volume = bb.Volume;
    double complexity = area / volume;

    return complexity;
  }

  // Reference Shape Curvature Complexity
  List<double> cComplexity (Brep reference, Mesh fabrication)
  {
    var curv = new List<double>();
    var curvComplexity = new List<double>();

    // Find the curvature for each center of the reference shape.
    for (int i = 0; i < fabrication.Faces.Count; i++)
    {
      var center = fabrication.Faces.GetFaceCenter(i);
      Point3d closest;
      ComponentIndex ci;
      double u, v;
      Vector3d normal;
      reference.ClosestPoint(center, out closest, out ci, out u, out v, double.MaxValue, out normal);

      if(ci.ComponentIndexType == ComponentIndexType.BrepFace)
      {
        var surface = reference.Faces[ci.Index];
        var curvature = surface.CurvatureAt(u, v);
        curv.Add(curvature.Gaussian);
      }
      else //if(ci.ComponentIndexType == ComponentIndexType.BrepEdge)
      {
        throw new Exception("Face curvature is not projected to a surface.");
      }
    }

    // Get connected faces' index and compare the curvatures.
    for (int i = 0; i < fabrication.Faces.Count; i++)
    {
      int[] connected = fabrication.Faces.AdjacentFaces(i);
      double delta = 0;
      double faceCurvature = curv[i];

      foreach (var conn in connected)
      {
        double otherCurvature = curv[conn];
        delta += Math.Pow(faceCurvature - otherCurvature, 2);
      }

      curvComplexity.Add(delta);
    }

    return curvComplexity;
  }

  // Deviation - Vertices
  List<double> testVertex (Brep reference, Mesh fabrication)
  {
    var vertices = fabrication.TopologyVertices;
    var deviation = new List<double>();

    foreach (var vertex in vertices)
    {
      var closest = reference.ClosestPoint(vertex);
      var distanceSq = closest.DistanceToSquared(vertex);

      deviation.Add(distanceSq);
    }

    return deviation;
  }

  // Deviation - Edges
  List<double> testEdge(Brep reference, Mesh fabrication)
  {
    var edges = fabrication.TopologyEdges;
    var deviation = new List<double>();

    int numDiv = 5;
    double spacing = 1.0 / numDiv;
    double t;
    List<Point3d> pts = new List<Point3d>();

    for (int e = 0; e < edges.Count; e++)
    {
      var line = edges.EdgeLine(e);


      // Divide each edge.
      for (int i = 0; i <= numDiv; i++)
      {
        t = i * spacing;
        Point3d pt = line.PointAt(t);
        pts.Add(pt);
      }

      // Find the max of the distances.
      double max = 0;
      foreach (var point in pts)
      {
        var closest = reference.ClosestPoint(point);
        var distanceSq = closest.DistanceToSquared(point);
        if ( distanceSq > max)
          max = distanceSq;
      }

      deviation.Add(max);
    }

    return deviation;
  }

  // Deviation - Faces
  List<double> testFace(Brep reference, Mesh fabrication)
  {
    var deviation = new List<double>();

    int numDiv = 9;
    double spacing = 1.0 / numDiv;
    List<Point3d> pts = new List<Point3d>();

    foreach(MeshFace face in fabrication.Faces)
    {
      NurbsSurface srf = Rhino.Geometry.NurbsSurface.CreateFromCorners(fabrication.Vertices[face.A], fabrication.Vertices[face.B], fabrication.Vertices[face.C], fabrication.Vertices[face.D]);
      srf.SetDomain(0, new Interval(0, 1));
      srf.SetDomain(1, new Interval(0, 1));

      // Divide the faces.
      for (double i = spacing; i < 1; i += spacing)
      {
        for (double j = 0; j < 1; j += spacing)
        {
          Point3d pt = srf.PointAt(i, j);
          pts.Add(pt);
        }
      }

      // Find the max of the distances.
      double max = 0;
      foreach (var point in pts)
      {
        var closest = reference.ClosestPoint(point);
        var distanceSq = closest.DistanceToSquared(point);
        if ( distanceSq > max)
          max = distanceSq;
      }

      deviation.Add(max);
    }

    return deviation;
  }

  // Discretization Efficiency

  // Congruent Vertices - Nodes
  Dictionary<int,List<int>> GroupVerticesByAngle(Mesh fabrication, double tol)
  {
    Dictionary<int,List<int>> groups = new Dictionary<int,List<int>>();
    List<Point3d> pts = new List<Point3d>();

    for (int i = 0; i < fabrication.TopologyVertices.Count; i++)
    {
      // get the vertices that are connected throufh lines
      // i return ndices of all topological vertices that are connected to this topological vertex.
      // pts = fabrication.TopologyVertices.ConnectedTopologyVertices(i);

      List<Vector3d> vctrs = new List<Vector3d>();

      foreach(var pt in pts)
      {
        //var vctr = new Vector3d.Subtract(fabrication.TopologyVertices(i), pt);
      }
      // public static double VectorAngle( Vector3d a, Vector3d b)

    }

    return groups;
  }

  // Congruent Edges - Connection Members
  Dictionary<int,List<int>> GroupEdgeByLength(Mesh fabrication, double tol)
  {
    Dictionary<int,List<int>> groups = new Dictionary<int,List<int>>();

    for (int i = 0; i < fabrication.TopologyEdges.Count; i++)
    {
      var length = fabrication.TopologyEdges.EdgeLine(i).Length;
      var roundedLength = (int) Math.Round(length / tol);

      List<int> bucket;
      if(!groups.TryGetValue(roundedLength, out bucket))
      {
        bucket = new List<int>();
        groups.Add(roundedLength, bucket);
      }

      bucket.Add(i);

    }

    return groups;
  }

  // Congruent Faces - Panels
  List<List<int>> GroupFaces(Mesh fabrication, double tol)
  {
    // Dictionary<int,List<int>> groups = new Dictionary<int,List<int>>();
    var perimeters = new List<Polyline>();

    foreach (MeshFace face in fabrication.Faces)
    {
      // Perimeter
      var polyline = new Polyline()
        {
          fabrication.Vertices[face.A],
          fabrication.Vertices[face.B],
          fabrication.Vertices[face.C],
          fabrication.Vertices[face.D]
          };
      polyline.Add(polyline[0]);
      perimeters.Add(polyline);
    }

    int faceCount = fabrication.Faces.Count;

    var hasBeenAdded = new bool[faceCount];

    var congruentGroups = new List<List<int>>();

    for (int i = 0; i < faceCount - 1; i++)
    {
      if(hasBeenAdded[i]) continue;
      var a = perimeters[i];
      var congruentGroup = new List<int>();
      congruentGroup.Add(i);

      for (int j = i + 1; j < faceCount; j++)
      {
        if(hasBeenAdded[j]) continue;

        var b = perimeters[j];
        bool isCongruent = AreCongruent(a, b, 0.01, 0.01);
        if(isCongruent)
        {
          congruentGroup.Add(j);
          hasBeenAdded[j] = true;
        }
      }

      congruentGroups.Add(congruentGroup);
    }


    // Edge length
    // How can I create a list adding 4 elements in 1 index?

    // Angles
    //Vector3d vctr = new Vector3d.Subtract(fabrication.vert
    //var angleA =
    //throw new Exception("Todo");

    return congruentGroups;
  }

  bool AreCongruent(Polyline a, Polyline b, double tolLength, double tolAngle)
  {
    var lengthsA = a.GetSegments().Select(s => s.Length).ToList();
    var lengthsB = b.GetSegments().Select(s => s.Length).ToList();
    var dupLengthsB = new List<double>();
    dupLengthsB.AddRange(lengthsB);
    dupLengthsB.AddRange(lengthsB);

    if(lengthsA.Count != lengthsB.Count)
      return false;

    int count = lengthsA.Count;


    double firstLengthA = lengthsA[0];
    bool isEdgeCongruent = false;

    for (int i = 0; i < count; i++)
    {
      isEdgeCongruent = false;
      double edgeB = lengthsB[i];
      double distance = Math.Abs(firstLengthA - edgeB);

      if(distance < tolLength)
      {
        isEdgeCongruent = true;
        for (int j = 1; j < count; j++)
        {
          double lengthA = lengthsA[j];
          double lengthB = dupLengthsB[i + j];

          double edgeDistance = Math.Abs(lengthA - lengthB);

          if(edgeDistance > tolLength)
          {
            isEdgeCongruent = false;
            break;
          }
        }

        if(isEdgeCongruent)
        {
          break;
        }
      }
    }

    bool isAngleCongruent = true;

    return isEdgeCongruent && isAngleCongruent;
  }
# ---------- end after_the_last_review ----------
new_evaluation_model = CSharpScript(r=brep_reference_shape, f=mesh_fabrication_graph)  # -> out, ACompexity, BCurvatureComplexity, CVerticesDeviation, DSumVerticesDeviation, EEdgesDeviation, FFacesDeviation, GDeviationComplexity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; inputs r: Brep, f: Mesh
# ---------- new_evaluation_model: C# ----------
    // Represantation Accuracy

    // Reference Shape Complexity
    ACompexity = Complexity(r);

    List<double> ComplexityCurvature = cComplexity(r, f);
    BCurvatureComplexity = ComplexityCurvature;

    // Deviation - Vertices
    List<double> deviationV = testVertex(r, f);

    double sumErrorV = 0;
    foreach (var d in deviationV)
      sumErrorV += d;

    CVerticesDeviation = deviationV;
    DSumVerticesDeviation = sumErrorV;

    // Deviation - Edges
    List<double> deviationE = testEdge(r, f);

    EEdgesDeviation = deviationE;

    // Deviation - Faces
    List<double> deviationF = testFace(r, f);

    FFacesDeviation = deviationF;

    // Deviation - Faces / Complexity
    List<double> curvatureComplexity = cComplexity(r, f);

    double dc;
    List<double> deviationC = new List<double>();
    for (int q = 0; q < deviationF.Count(); q++)
    {
      if (curvatureComplexity[q] == 0)
      {
        dc = deviationF[q];
      }
      else
      {
        dc = deviationF[q] / curvatureComplexity[q];
      }
      deviationC.Add(dc);
    }
    GDeviationComplexity = deviationC;

    // Discretization Efficiency

    // VerticesGroup

    var verticesGroups = GroupVertices(f);

    var similarTree = new DataTree<int>();
    int z = 0;
    foreach (var similarGroup in verticesGroups)
    {
      similarTree.AddRange(similarGroup, new GH_Path(z++));
    }
    //VerticesGroups = similarTree;

    // EdgeGroupKeys (similarity values), EdgeGroupValues(indices)- Edges (similarities)

    var edgeGroups = GroupEdgeByLength(f, 0.01);
    EdgeGroupKeys = edgeGroups.Select(g => g.Key);

    var edgeTree = new DataTree<int>();
    int i = 0;
    foreach(var edgeGroup in edgeGroups)
    {
      edgeTree.AddRange(edgeGroup.Value, new GH_Path(i++));
    }

    EdgeGroupValues = edgeTree;

    // congruentGroups - Faces (congruency

    var congruentGroups = GroupFaces(f, 0.01);

    var congruentTree = new DataTree<int>();
    int j = 0;
    foreach(var congruentGroup in congruentGroups)
    {
      congruentTree.AddRange(congruentGroup, new GH_Path(j++));
    }

    CongruentGroups = congruentTree;
# ---------- new_evaluation_model: C# additional code ----------
  // Represantation Accuracy

  // Reference Shape Complexity: R area / Bb volume
  double Complexity (Brep reference)
  {
    double area = reference.GetArea();
    BoundingBox bb = reference.GetBoundingBox(true);
    double volume = bb.Volume;
    double complexity = area / volume;

    return complexity;
  }

  // Reference Shape Curvature Complexity
  List<double> cComplexity (Brep reference, Mesh fabrication)
  {
    var curv = new List<double>();
    var curvComplexity = new List<double>();

    // Find the curvature for each center of the reference shape.
    for (int i = 0; i < fabrication.Faces.Count; i++)
    {
      var center = fabrication.Faces.GetFaceCenter(i);
      Point3d closest;
      ComponentIndex ci;
      double u, v;
      Vector3d normal;
      reference.ClosestPoint(center, out closest, out ci, out u, out v, double.MaxValue, out normal);

      if(ci.ComponentIndexType == ComponentIndexType.BrepFace)
      {
        var surface = reference.Faces[ci.Index];
        var curvature = surface.CurvatureAt(u, v);
        curv.Add(curvature.Gaussian);
      }
      else //if(ci.ComponentIndexType == ComponentIndexType.BrepEdge)
      {
        throw new Exception("Face curvature is not projected to a surface.");
      }
    }

    // Get connected faces' index and compare the curvatures.
    for (int i = 0; i < fabrication.Faces.Count; i++)
    {
      int[] connected = fabrication.Faces.AdjacentFaces(i);
      double delta = 0;
      double faceCurvature = curv[i];

      foreach (var conn in connected)
      {
        double otherCurvature = curv[conn];
        delta += Math.Pow(faceCurvature - otherCurvature, 2);
      }

      curvComplexity.Add(delta);
    }

    return curvComplexity;
  }

  // Deviation - Vertices
  List<double> testVertex (Brep reference, Mesh fabrication)
  {
    var vertices = fabrication.TopologyVertices;
    var deviation = new List<double>();

    foreach (var vertex in vertices)
    {
      var closest = reference.ClosestPoint(vertex);
      var distanceSq = closest.DistanceToSquared(vertex);

      deviation.Add(distanceSq);
    }

    return deviation;
  }

  // Deviation - Edges
  List<double> testEdge(Brep reference, Mesh fabrication)
  {
    var edges = fabrication.TopologyEdges;
    var deviation = new List<double>();

    int numDiv = 5;
    double spacing = 1.0 / numDiv;
    double t;
    List<Point3d> pts = new List<Point3d>();

    for (int e = 0; e < edges.Count; e++)
    {
      var line = edges.EdgeLine(e);


      // Divide each edge.
      for (int i = 0; i <= numDiv; i++)
      {
        t = i * spacing;
        Point3d pt = line.PointAt(t);
        pts.Add(pt);
      }

      // Find the max of the distances.
      double max = 0;
      foreach (var point in pts)
      {
        var closest = reference.ClosestPoint(point);
        var distanceSq = closest.DistanceToSquared(point);
        if ( distanceSq > max)
          max = distanceSq;
      }

      deviation.Add(max);
    }

    return deviation;
  }

  // Deviation - Faces
  List<double> testFace(Brep reference, Mesh fabrication)
  {
    var deviation = new List<double>();

    int numDiv = 9;
    double spacing = 1.0 / numDiv;
    List<Point3d> pts = new List<Point3d>();

    foreach(MeshFace face in fabrication.Faces)
    {
      NurbsSurface srf = Rhino.Geometry.NurbsSurface.CreateFromCorners(fabrication.Vertices[face.A], fabrication.Vertices[face.B], fabrication.Vertices[face.C], fabrication.Vertices[face.D]);
      srf.SetDomain(0, new Interval(0, 1));
      srf.SetDomain(1, new Interval(0, 1));

      // Divide the faces.
      for (double i = spacing; i < 1; i += spacing)
      {
        for (double j = 0; j < 1; j += spacing)
        {
          Point3d pt = srf.PointAt(i, j);
          pts.Add(pt);
        }
      }

      // Find the max of the distances.
      double max = 0;
      foreach (var point in pts)
      {
        var closest = reference.ClosestPoint(point);
        var distanceSq = closest.DistanceToSquared(point);
        if ( distanceSq > max)
          max = distanceSq;
      }

      deviation.Add(max);
    }

    return deviation;
  }

  // Discretization Efficiency

  // Similar Vertices - Nodes

  List<List<int>> GroupVertices(Mesh fabrication)
  {
    int verticesCount = fabrication.Vertices.Count;

    var hasBeenAdded = new bool[verticesCount];

    var similarGroups = new List<List<int>>();

    for (int i = 0; i < verticesCount - 1; i++)
    {
      int a = i;
      if(hasBeenAdded[i]) continue;
      var similarGroup = new List<int>();
      similarGroup.Add(i);

      for (int j = i + 1; j < verticesCount; j++)
      {
        if(hasBeenAdded[j]) continue;
        int b = j;
        bool isSimilar = AreSimilar(fabrication, a, b, 0.01);
        if(isSimilar)
        {
          similarGroup.Add(j);
          hasBeenAdded[j] = true;
        }
      }

      similarGroups.Add(similarGroup);
    }

    return similarGroups;
  }

  bool AreSimilar (Mesh fabrication, int a, int b, double tolAngle)
  {
    // Indices of Edges Lists for each
    var connEdgesA = fabrication.TopologyVertices.ConnectedEdges(a); //return indices of all edges around the vertex
    var connEdgesB = fabrication.TopologyVertices.ConnectedEdges(b);


    // Vector Lists for each edge
    var vctrsA = new List<Vector3d>();
    var vctrsB = new List<Vector3d>();

    foreach (var edge in connEdgesA)
    {
      vctrsA.Add(fabrication.TopologyEdges.EdgeLine(edge).UnitTangent);
    }
    foreach (var edge in connEdgesB)
    {
      vctrsB.Add(fabrication.TopologyEdges.EdgeLine(edge).UnitTangent);
    }

    // Angle Lists

    double angle;
    var anglesA = new List<double>();
    var anglesB = new List<double>();
    for (int i = 0; i < vctrsA.Count; i++)
    {
      if (i != vctrsA.Count - 1)
      {
        angle = Vector3d.VectorAngle(vctrsA[i], vctrsA[i + 1]);
      }
      else
      {
        angle = Vector3d.VectorAngle(vctrsB[i], vctrsB[0]);
      }
      anglesA.Add(angle);
    }
    for (int i = 0; i < vctrsB.Count; i++)
    {
      if (i != vctrsA.Count - 1)
      {
        angle = Vector3d.VectorAngle(vctrsA[i], vctrsA[i + 1]);
      }
      else
      {
        angle = Vector3d.VectorAngle(vctrsA[i], vctrsA[0]);
      }
      anglesB.Add(angle);
    }

    // Comparing the angles
    var dupanglesB = new List<double>();
    dupanglesB.AddRange(anglesB);
    dupanglesB.AddRange(anglesB);

    int count = anglesB.Count;
    double firstAngleA = anglesA[0];
    bool isSimilar = false;

    if (vctrsA.Count != vctrsB.Count)
      return false;

    for (int i = 0; i < count; i++)
    {
      isSimilar = false;
      double angleB = anglesB[i];
      double Difference = Math.Abs(firstAngleA - angleB);

      if(Difference < tolAngle)
      {
        isSimilar = true;
        for (int j = 1; j < count; j++)
        {
          double angleA = anglesA[j];
          angleB = dupanglesB[i + j];

          double angleDifference = Math.Abs(angleA - angleB);

          if(angleDifference > tolAngle)
          {
            isSimilar = false;
            break;
          }
        }

        if(isSimilar)
        {
          break;
        }
      }
    }

    return isSimilar;

  }

  // Congruent Edges - Connection Members

  Dictionary<int,List<int>> GroupEdgeByLength(Mesh fabrication, double tol)
  {
    Dictionary<int,List<int>> groups = new Dictionary<int,List<int>>();

    for (int i = 0; i < fabrication.TopologyEdges.Count; i++)
    {
      var length = fabrication.TopologyEdges.EdgeLine(i).Length;
      var roundedLength = (int) Math.Round(length / tol);

      List<int> bucket;
      if(!groups.TryGetValue(roundedLength, out bucket))
      {
        bucket = new List<int>();
        groups.Add(roundedLength, bucket);
      }

      bucket.Add(i);

    }

    return groups;
  }

  // Congruent Faces - Panels
  List<List<int>> GroupFaces(Mesh fabrication, double tol)
  {
    // Dictionary<int,List<int>> groups = new Dictionary<int,List<int>>();
    var perimeters = new List<Polyline>();

    foreach (MeshFace face in fabrication.Faces)
    {
      // Perimeter
      var polyline = new Polyline()
        {
          fabrication.Vertices[face.A],
          fabrication.Vertices[face.B],
          fabrication.Vertices[face.C],
          fabrication.Vertices[face.D]
          };
      polyline.Add(polyline[0]);
      perimeters.Add(polyline);
    }

    int faceCount = fabrication.Faces.Count;

    var hasBeenAdded = new bool[faceCount];

    var congruentGroups = new List<List<int>>();

    for (int i = 0; i < faceCount - 1; i++)
    {
      if(hasBeenAdded[i]) continue;
      var a = perimeters[i];
      var congruentGroup = new List<int>();
      congruentGroup.Add(i);

      for (int j = i + 1; j < faceCount; j++)
      {
        if(hasBeenAdded[j]) continue;

        var b = perimeters[j];
        bool isCongruent = AreCongruent(a, b, 0.01, 0.01);
        if(isCongruent)
        {
          congruentGroup.Add(j);
          hasBeenAdded[j] = true;
        }
      }

      congruentGroups.Add(congruentGroup);
    }

    return congruentGroups;
  }

  bool AreCongruent(Polyline a, Polyline b, double tolLength, double tolAngle)
  {
    var lengthsA = a.GetSegments().Select(s => s.Length).ToList();
    var lengthsB = b.GetSegments().Select(s => s.Length).ToList();
    var dupLengthsB = new List<double>();
    dupLengthsB.AddRange(lengthsB);
    dupLengthsB.AddRange(lengthsB);

    //new 1
    //var vectorsA = a.GetSegments().Select(s => s.UnitTangent).ToList();
    //var vectorsB = b.GetSegments().Select(s => s.UnitTangent).ToList();
    List<Vector3d> vectorsA = new List<Vector3d>();
    List<Vector3d> vectorsB = new List<Vector3d>();
    vectorsA = a.GetSegments().Select(e => e.UnitTangent).ToList();
    vectorsB = b.GetSegments().Select(e => e.UnitTangent).ToList();
    var anglesA = new List<double>();
    var anglesB = new List<double>();
    double anglesa, anglesb;

    for (int j = 0; j < vectorsA.Count; j++)
    {
      if (j != vectorsA.Count)
      {
        anglesa = Vector3d.VectorAngle(vectorsA[j], vectorsA[j + 1]);
        anglesb = Vector3d.VectorAngle(vectorsB[j], vectorsB[j + 1]);
      }
      else
      {
        anglesa = Vector3d.VectorAngle(vectorsA[j], vectorsA[0]);
        anglesb = Vector3d.VectorAngle(vectorsB[j], vectorsB[0]);
      }
      anglesA.Add(anglesa);
      anglesB.Add(anglesb);
    }

    var dupAnglesB = new List<double>();
    dupAnglesB.AddRange(anglesB);
    dupAnglesB.AddRange(anglesB);
    //new 1

    if(lengthsA.Count != lengthsB.Count)
      return false;

    int count = lengthsA.Count;

    double firstLengthA = lengthsA[0];
    bool isCongruent = false;

    //new 2
    double firstAngleA = anglesA[0];
    //new 2

    for (int i = 0; i < count; i++)
    {
      isCongruent = false;
      double edgeB = lengthsB[i];
      double distance = Math.Abs(firstLengthA - edgeB);

      //new 3
      double angleB = anglesB[i];
      double angle = Math.Abs(firstAngleA - angleB);
      //new 3

      if(distance < tolLength && angle < tolAngle) //new 4
      {
        isCongruent = true;
        for (int j = 1; j < count; j++)
        {
          double lengthA = lengthsA[j];
          double lengthB = dupLengthsB[i + j];

          double edgeDistance = Math.Abs(lengthA - lengthB);

          //new
          double angleA = anglesA[j];
          angleB = dupAnglesB[i + j];

          double angleDifference = Math.Abs(angleA - angleB);
          //new 5

          if(edgeDistance > tolLength || angleDifference > tolAngle) //new 6
          {
            isCongruent = false;
            break;
          }
        }

        if(isCongruent)
        {
          break;
        }
      }
    }

    return isCongruent;
  }
# ---------- end new_evaluation_model ----------
panel = Panel(after_the_last_review.CongruentGroups)
similarnodes = CSharpScript(r=brep_reference_shape, f=mesh_fabrication_graph)  # -> out, VerticesGroups; inputs r: Brep, f: Mesh
# ---------- similarnodes: C# ----------
    // VerticesGroup

    var verticesGroups = GroupVertices(f);

    var similarTree = new DataTree<int>();
    int z = 0;
    foreach (var similarGroup in verticesGroups)
    {
      similarTree.AddRange(similarGroup, new GH_Path(z++));
    }
    //VerticesGroups = similarTree;
# ---------- similarnodes: C# additional code ----------
  // Similar Vertices - Nodes

  List<List<int>> GroupVertices(Mesh fabrication)
  {
    int verticesCount = fabrication.Vertices.Count;

    var hasBeenAdded = new bool[verticesCount];

    var similarGroups = new List<List<int>>();

    for (int i = 0; i < verticesCount - 1; i++)
    {
      int a = i;
      if(hasBeenAdded[i]) continue;
      var similarGroup = new List<int>();
      
      similarGroup.Add(i);

      for (int j = i + 1; j < verticesCount; j++)
      {
        if(hasBeenAdded[j]) continue;
        
        int b = j;
        bool isSimilar = AreSimilar(fabrication, a, b, 0.01);
        if(isSimilar)
        {
          similarGroup.Add(j);
          hasBeenAdded[j] = true;
        }
      }

      similarGroups.Add(similarGroup);
    }

    return similarGroups;
  }

  bool AreSimilar (Mesh fabrication, int a, int b, double tolAngle)
  {
    // Indices of Edges Lists for each
    var connEdgesA = fabrication.TopologyVertices.ConnectedEdges(a); //return indices of all edges around the vertex
    var connEdgesB = fabrication.TopologyVertices.ConnectedEdges(b);


    // Vector Lists for each edge
    var vctrsA = new List<Vector3d>();
    var vctrsB = new List<Vector3d>();

    foreach (var edge in connEdgesA)
    {
      vctrsA.Add(fabrication.TopologyEdges.EdgeLine(edge).UnitTangent);
    }
    foreach (var edge in connEdgesB)
    {
      vctrsB.Add(fabrication.TopologyEdges.EdgeLine(edge).UnitTangent);
    }

    // Angle Lists

    double angle;
    var anglesA = new List<double>();
    var anglesB = new List<double>();
    for (int i = 0; i < vctrsA.Count; i++)
    {
      if (i != vctrsA.Count - 1)
      {
        angle = Vector3d.VectorAngle(vctrsA[i], vctrsA[i + 1]);
      }
      else
      {
        angle = Vector3d.VectorAngle(vctrsB[i], vctrsB[0]);
      }
      anglesA.Add(angle);
    }
    for (int i = 0; i < vctrsB.Count; i++)
    {
      if (i != vctrsA.Count - 1)
      {
        angle = Vector3d.VectorAngle(vctrsA[i], vctrsA[i + 1]);
      }
      else
      {
        angle = Vector3d.VectorAngle(vctrsA[i], vctrsA[0]);
      }
      anglesB.Add(angle);
    }

    // Comparing the angles
    var dupanglesB = new List<double>();
    dupanglesB.AddRange(anglesB);
    dupanglesB.AddRange(anglesB);

    int count = anglesB.Count;
    double firstAngleA = anglesA[0];
    bool isSimilar = false;

    if (vctrsA.Count != vctrsB.Count)
      return false;

    for (int i = 0; i < count; i++)
    {
      isSimilar = false;
      double angleB = anglesB[i];
      double Difference = Math.Abs(firstAngleA - angleB);

      if(Difference < tolAngle)
      {
        isSimilar = true;
        for (int j = 1; j < count; j++)
        {
          double angleA = anglesA[j];
          angleB = dupanglesB[i + j];

          double angleDifference = Math.Abs(angleA - angleB);

          if(angleDifference > tolAngle)
          {
            isSimilar = false;
            break;
          }
        }

        if(isSimilar)
        {
          break;
        }
      }
    }

    return isSimilar;

  }
# ---------- end similarnodes ----------
similarnodes_2 = CSharpScript(r=brep_reference_shape, f=mesh_fabrication_graph)  # -> out, VerticesGroups; inputs r: Brep, f: Mesh
# ---------- similarnodes_2: C# ----------
    // VerticesGroup

    var verticesGroups = GroupVertices(f);

    var similarTree = new DataTree<int>();
    int z = 0;
    foreach (var similarGroup in verticesGroups)
    {
      similarTree.AddRange(similarGroup, new GH_Path(z++));
    }
    VerticesGroups = similarTree;
# ---------- similarnodes_2: C# additional code ----------
  // Similar Vertices - Nodes

  List<List<int>> GroupVertices(Mesh fabrication)
  {
    int verticesCount = fabrication.Vertices.Count;

    var hasBeenAdded = new bool[verticesCount];

    var similarGroups = new List<List<int>>();

    for (int i = 0; i < verticesCount - 1; i++)
    {
      int a = i;
      if(hasBeenAdded[i]) continue;
      var similarGroup = new List<int>();

      similarGroup.Add(i);

      for (int j = i + 1; j < verticesCount; j++)
      {
        if(hasBeenAdded[j]) continue;

        int b = j;
        bool isSimilar = AreSimilar(fabrication, a, b, 0.01);
        if(isSimilar)
        {
          similarGroup.Add(j);
          hasBeenAdded[j] = true;
        }
      }

      similarGroups.Add(similarGroup);
    }

    return similarGroups;
  }

  bool AreSimilar (Mesh fabrication, int a, int b, double tolAngle)
  {
    // Indices of Edges Lists for each
    var connEdgesA = fabrication.TopologyVertices.ConnectedEdges(a); //return indices of all edges around the vertex
    var connEdgesB = fabrication.TopologyVertices.ConnectedEdges(b);


    // Vector Lists for each edge
    var vctrsA = new List<Vector3d>();
    var vctrsB = new List<Vector3d>();

    foreach (var edge in connEdgesA)
    {
      vctrsA.Add(fabrication.TopologyEdges.EdgeLine(edge).UnitTangent);
    }
    foreach (var edge in connEdgesB)
    {
      vctrsB.Add(fabrication.TopologyEdges.EdgeLine(edge).UnitTangent);
    }

    // Angle Lists

    double angle;
    var anglesA = new List<double>();
    var anglesB = new List<double>();

    for (int i = 0; i < vctrsA.Count; i++)
    {
      if (i < vctrsA.Count - 1 ) // i != vctrsA.Count-1
      {
        //angle = Vector3d.VectorAngle(vctrsA[i], vctrsA[i]);
        angle = 0;
      }
      else
      {
        //angle = Vector3d.VectorAngle(vctrsB[i], vctrsB[i]);
        angle = 0;
      }
      anglesA.Add(angle);
    }

    for (int i = 0; i < vctrsB.Count; i++)
    {
      if (i < vctrsB.Count - 1 )
      {
        //angle = Vector3d.VectorAngle(vctrsA[i], vctrsA[i]);
        angle = 0;
      }
      else
      {
        //angle = Vector3d.VectorAngle(vctrsA[i], vctrsA[i]);
        angle = 0;
      }
      anglesB.Add(angle);

    }

    // Comparing the angles
    var dupanglesB = new List<double>();
    dupanglesB.AddRange(anglesB);
    dupanglesB.AddRange(anglesB);

    int count = anglesB.Count;
    double firstAngleA = anglesA[0];
    bool isSimilar = false;

    if (vctrsA.Count != vctrsB.Count)
      return false;

    for (int i = 0; i < count; i++)
    {
      isSimilar = false;
      double angleB = anglesB[i];
      double Difference = Math.Abs(firstAngleA - angleB);

      if(Difference < tolAngle)
      {
        isSimilar = true;
        for (int j = 1; j < count; j++)
        {
          double angleA = anglesA[j];
          angleB = dupanglesB[i + j];

          double angleDifference = Math.Abs(angleA - angleB);

          if(angleDifference > tolAngle)
          {
            isSimilar = false;
            break;
          }
        }

        if(isSimilar)
        {
          break;
        }
      }
    }

    return isSimilar;

  }
# ---------- end similarnodes_2 ----------
congruentfaces = CSharpScript(r=brep_reference_shape, f=mesh_fabrication_graph)  # -> out, CongruentGroups; inputs r: Brep, f: Mesh
# ---------- congruentfaces: C# ----------
    // congruentGroups - Faces (congruency

    var congruentGroups = GroupFaces(f, 0.01);

    var congruentTree = new DataTree<int>();
    int j = 0;
    foreach(var congruentGroup in congruentGroups)
    {
      congruentTree.AddRange(congruentGroup, new GH_Path(j++));
    }

    CongruentGroups = congruentTree;
# ---------- congruentfaces: C# additional code ----------
  // Congruent Faces - Panels
  List<List<int>> GroupFaces(Mesh fabrication, double tol)
  {
    // Dictionary<int,List<int>> groups = new Dictionary<int,List<int>>();
    var perimeters = new List<Polyline>();

    foreach (MeshFace face in fabrication.Faces)
    {
      // Perimeter
      var polyline = new Polyline()
        {
          fabrication.Vertices[face.A],
          fabrication.Vertices[face.B],
          fabrication.Vertices[face.C],
          fabrication.Vertices[face.D]
          };
      polyline.Add(polyline[0]);
      perimeters.Add(polyline);
    }

    int faceCount = fabrication.Faces.Count;

    var hasBeenAdded = new bool[faceCount];

    var congruentGroups = new List<List<int>>();

    for (int i = 0; i < faceCount - 1; i++)
    {
      if(hasBeenAdded[i]) continue;
      var a = perimeters[i];
      var congruentGroup = new List<int>();
      congruentGroup.Add(i);

      for (int j = i + 1; j < faceCount; j++)
      {
        if(hasBeenAdded[j]) continue;

        var b = perimeters[j];
        bool isCongruent = AreCongruent(a, b, 0.01, 0.01);
        if(isCongruent)
        {
          congruentGroup.Add(j);
          hasBeenAdded[j] = true;
        }
      }

      congruentGroups.Add(congruentGroup);
    }

    return congruentGroups;
  }

  bool AreCongruent(Polyline a, Polyline b, double tolLength, double tolAngle)
  {
    var lengthsA = a.GetSegments().Select(s => s.Length).ToList();
    var lengthsB = b.GetSegments().Select(s => s.Length).ToList();
    var dupLengthsB = new List<double>();
    dupLengthsB.AddRange(lengthsB);
    dupLengthsB.AddRange(lengthsB);

    //new 1
    //var vectorsA = a.GetSegments().Select(s => s.UnitTangent).ToList();
    //var vectorsB = b.GetSegments().Select(s => s.UnitTangent).ToList();
    //List<Vector3d> vectorsA = new List<Vector3d>();
    //List<Vector3d> vectorsB = new List<Vector3d>();
    var vectorsA = a.GetSegments().Select(e => e.UnitTangent).ToList();
    var vectorsB = b.GetSegments().Select(e => e.UnitTangent).ToList();
    var anglesA = new List<double>();
    var anglesB = new List<double>();
    double anglesa, anglesb;

    for (int j = 0; j < vectorsA.Count; j++)
    {
      if (j != vectorsA.Count)
      {
        anglesa = Vector3d.VectorAngle(vectorsA[j], vectorsA[j + 1]);
        anglesb = Vector3d.VectorAngle(vectorsB[j], vectorsB[j + 1]);
      }
      else
      {
        anglesa = Vector3d.VectorAngle(vectorsA[j], vectorsA[0]);
        anglesb = Vector3d.VectorAngle(vectorsB[j], vectorsB[0]);
      }
      anglesA.Add(anglesa);
      anglesB.Add(anglesb);
    }

    var dupAnglesB = new List<double>();
    dupAnglesB.AddRange(anglesB);
    dupAnglesB.AddRange(anglesB);
    //new 1

    if(lengthsA.Count != lengthsB.Count)
      return false;

    int count = lengthsA.Count;

    double firstLengthA = lengthsA[0];
    bool isCongruent = false;

    //new 2
    double firstAngleA = anglesA[0];
    //new 2

    for (int i = 0; i < count; i++)
    {
      isCongruent = false;
      double edgeB = lengthsB[i];
      double distance = Math.Abs(firstLengthA - edgeB);

      //new 3
      double angleB = anglesB[i];
      double angle = Math.Abs(firstAngleA - angleB);
      //new 3

      if(distance < tolLength && angle < tolAngle) //new 4
      {
        isCongruent = true;
        for (int j = 1; j < count; j++)
        {
          double lengthA = lengthsA[j];
          double lengthB = dupLengthsB[i + j];

          double edgeDistance = Math.Abs(lengthA - lengthB);

          //new
          double angleA = anglesA[j];
          angleB = dupAnglesB[i + j];

          double angleDifference = Math.Abs(angleA - angleB);
          //new 5

          if(edgeDistance > tolLength || angleDifference > tolAngle) //new 6
          {
            isCongruent = false;
            break;
          }
        }

        if(isCongruent)
        {
          break;
        }
      }
    }

    return isCongruent;
  }
# ---------- end congruentfaces ----------
congruentfaces_2 = CSharpScript(r=brep_reference_shape, f=mesh_fabrication_graph)  # -> out, CongruentGroups; inputs r: Brep, f: Mesh
# ---------- congruentfaces_2: C# ----------
    // congruentGroups - Faces (congruency

    var congruentGroups = GroupFaces(f, 0.01);

    var congruentTree = new DataTree<int>();
    int j = 0;
    foreach(var congruentGroup in congruentGroups)
    {
      congruentTree.AddRange(congruentGroup, new GH_Path(j++));
    }

    CongruentGroups = congruentTree;
# ---------- congruentfaces_2: C# additional code ----------
  // Congruent Faces - Panels
  List<List<int>> GroupFaces(Mesh fabrication, double tol)
  {
    // Dictionary<int,List<int>> groups = new Dictionary<int,List<int>>();
    var perimeters = new List<Polyline>();

    foreach (MeshFace face in fabrication.Faces)
    {
      // Perimeter
      var polyline = new Polyline()
        {
          fabrication.Vertices[face.A],
          fabrication.Vertices[face.B],
          fabrication.Vertices[face.C],
          fabrication.Vertices[face.D]
          };
      polyline.Add(polyline[0]);
      perimeters.Add(polyline);
    }

    int faceCount = fabrication.Faces.Count;

    var hasBeenAdded = new bool[faceCount];

    var congruentGroups = new List<List<int>>();

    for (int i = 0; i < faceCount - 1; i++)
    {
      if(hasBeenAdded[i]) continue;
      var a = perimeters[i];
      var congruentGroup = new List<int>();
      congruentGroup.Add(i);

      for (int j = i + 1; j < faceCount; j++)
      {
        if(hasBeenAdded[j]) continue;

        var b = perimeters[j];
        bool isCongruent = AreCongruent(a, b, 0.01, 0.01);
        if(isCongruent)
        {
          congruentGroup.Add(j);
          hasBeenAdded[j] = true;
        }
      }

      congruentGroups.Add(congruentGroup);
    }

    return congruentGroups;
  }

  bool AreCongruent(Polyline a, Polyline b, double tolLength, double tolAngle)
  {
    var lengthsA = a.GetSegments().Select(s => s.Length).ToList();
    var lengthsB = b.GetSegments().Select(s => s.Length).ToList();
    var dupLengthsB = new List<double>();
    dupLengthsB.AddRange(lengthsB);
    dupLengthsB.AddRange(lengthsB);

    //new 1
    //var vectorsA = a.GetSegments().Select(s => s.UnitTangent).ToList();
    //var vectorsB = b.GetSegments().Select(s => s.UnitTangent).ToList();
    //List<Vector3d> vectorsA = new List<Vector3d>();
    //List<Vector3d> vectorsB = new List<Vector3d>();
    var vectorsA = a.GetSegments().Select(e => e.UnitTangent).ToList();
    var vectorsB = b.GetSegments().Select(e => e.UnitTangent).ToList();
    var anglesA = new List<double>();
    var anglesB = new List<double>();
    double anglesa, anglesb;

    for (int j = 0; j < vectorsA.Count; j++)
    {
    /*  if (j != vectorsA.Count)
      {
        anglesa = Vector3d.VectorAngle(vectorsA[j], vectorsA[j + 1]);
        anglesb = Vector3d.VectorAngle(vectorsB[j], vectorsB[j + 1]);
      }
      else
      {
        anglesa = Vector3d.VectorAngle(vectorsA[j], vectorsA[0]);
        anglesb = Vector3d.VectorAngle(vectorsB[j], vectorsB[0]);
      }*/
      anglesa = 0;
      anglesb = 0;
      anglesA.Add(anglesa);
      anglesB.Add(anglesb);
    }

    var dupAnglesB = new List<double>();
    dupAnglesB.AddRange(anglesB);
    dupAnglesB.AddRange(anglesB);
    //new 1

    if(lengthsA.Count != lengthsB.Count)
      return false;

    int count = lengthsA.Count;

    double firstLengthA = lengthsA[0];
    bool isCongruent = false;

    //new 2
    double firstAngleA = anglesA[0];
    //new 2

    for (int i = 0; i < count; i++)
    {
      isCongruent = false;
      double edgeB = lengthsB[i];
      double distance = Math.Abs(firstLengthA - edgeB);

      //new 3
      double angleB = anglesB[i];
      double angle = Math.Abs(firstAngleA - angleB);
      //new 3

      if(distance < tolLength && angle < tolAngle) //new 4
      {
        isCongruent = true;
        for (int j = 1; j < count; j++)
        {
          double lengthA = lengthsA[j];
          double lengthB = dupLengthsB[i + j];

          double edgeDistance = Math.Abs(lengthA - lengthB);

          //new
          double angleA = anglesA[j];
          angleB = dupAnglesB[i + j];

          double angleDifference = Math.Abs(angleA - angleB);
          //new 5

          if(edgeDistance > tolLength || angleDifference > tolAngle) //new 6
          {
            isCongruent = false;
            break;
          }
        }

        if(isCongruent)
        {
          break;
        }
      }
    }

    return isCongruent;
  }
# ---------- end congruentfaces_2 ----------
# SIMILAR VERTICES (nodes)
# 
# Obviously, the error says that I am trying to access a list using an index larger than the last item’s index of the list. If I remove the Vectors’ coding part the code is working as you can see in the component. So, I believe that I am creating the vectors or the angle lists in a wrong way or I do not use correctly the 'UnitTangent' ot the 'VectorAngle'.
# Lines: 147 – 173.
panel_2 = Panel(similarnodes.out)
panel_3 = Panel(similarnodes_2.VerticesGroups)
# CONGRUENT FACES
# The error is similar again. If I comment out the lines: 158 - 167 and add all the angles = 0, the code is working. So, obviously, I do not use correctly either the 'UnitTangent' or the 'VectorAngle'.
panel_4 = Panel(congruentfaces.out)
panel_5 = Panel(congruentfaces_2.CongruentGroups)
